% Simulink data dictionary dictionary_axon.sldd

axon_command = Simulink.Bus()
  CMD: uint8[9 1]
  SZE: uint8[9 3]
  PYD: uint8[9 1000]

axon_CMD = Simulink.Parameter(struct(CMD=uint8(repmat(0, 9, 1)), SZE=uint8(repmat(0, 9, 3)), PYD=uint8(repmat(0, 9, 1000))), StorageClass="ExportedGlobal", DataType="Bus: axon_command")  % Default value for axon_command

axon_stream = Simulink.Bus()
  SZE: uint8[3 3]
  PYD: uint8[3 1000]

axon_STM = Simulink.Parameter(struct(SZE=uint8(repmat(0, 3, 3)), PYD=uint8(repmat(0, 3, 1000))), StorageClass="ExportedGlobal", DataType="Bus: axon_stream")  % Default value for axon_stream